# Grasshopper definition GH_RhinoUI_ExampleFile.gh (Grasshopper 1.0.7)

cornerradius = Slider(14, range=0..100)
floorsize = Slider(29, range=0..100)

# ----
# Toggle to "Start" or "Stop" floating window
toggle = BooleanToggle(False)
rhinoui = CSharpScript(
    show=toggle,
    TooltipDescriptionOverride="A simple RhinoUI that bridges rhino with GH controlling all parameters from Rhino",
    Reference=["C:\Program Files\Rhino 6\System\Eto.dll", "C:\Program Files\Rhino 6\System\Newtonsoft.Json.dll", "C:\Program Files\Rhino 6\System\RhinoCommon.dll", "C:\Windows\Microsoft.NET\Framework64\v4.0.30319\System.Runtime.dll"])  # -> out, A; inputs show: Boolean
# ---------- rhinoui: C# usings ----------
using System.IO;
using Eto.Forms;
using Eto.Drawing;
using Grasshopper.Kernel.Special;
using Newtonsoft.Json;
# ---------- rhinoui: C# ----------
    if (show)
    {
      if (ParamWindow.Instance == null)
      {
        var win = new ParamWindow(PARAMS);
        win.Show();
      }
    }
    else
    {
      if (ParamWindow.Instance != null)
      {
        ParamWindow.Instance.Close();
        ParamWindow.Instance = null;
      }
    }
# ---------- rhinoui: C# additional code ----------
  /// <summary>
  /// These are the parameters that appear in rhino interface add/remove params here.
  /// San Fran folks : names must be same as sliders i used a class cause its cleaner and solves some clashes.
  /// </summary>
  static List<ParamDef> PARAMS = new List<ParamDef>
    {
      new ParamDef("FloorSize"),
      new ParamDef("CornerRadius"),
      new ParamDef("FloorHeight"),
      new ParamDef("FloorNum"),
      new ParamDef("topCircleR"),
      new ParamDef("FloorRotationAngle")
      };

  // Simple data holder for one parameter's definition
  public class ParamDef
  {
    public string Name;

    public ParamDef(string name)
    {
      Name = name;
    }
  }

  /// <summary>
  /// GH canvas sliders methods to search and wire
  /// </summary>

  // Searches the GH canvas for a slider by its nickname
  static GH_NumberSlider FindSlider(GH_Document doc, string nickname)
  {
    foreach (var obj in doc.Objects)
    {
      GH_NumberSlider sl = obj as GH_NumberSlider;
      if (sl != null && sl.NickName == nickname)
        return sl;
    }
    return null;
  }

  // Gets the current value of a slider
  static double? GetSliderValue(GH_Document doc, string nickname)
  {
    var sl = FindSlider(doc, nickname);
    if (sl != null)
      return (double) sl.Slider.Value;
    return null;
  }

  // Sets a slider to a new value and triggers GH to recompute
  static void SetSlider(GH_Document doc, string nickname, double value)
  {
    var sl = FindSlider(doc, nickname);
    if (sl == null) return;

    double clamped = Math.Max((double) sl.Slider.Minimum,
      Math.Min((double) sl.Slider.Maximum, value));

    sl.Slider.Value = (decimal) clamped;
    sl.ExpireSolution(false);
  }


  public class ParamWindow : Form
  {
    // Static reference keeps the window alive between GH solves
    public static ParamWindow Instance;

    private List<ParamDef> _config;

    // These store the UI controls so we can read/write them
    private Dictionary<string, Slider> _sliders = new Dictionary<string, Slider>();
    private Dictionary<string, Label>  _readouts = new Dictionary<string, Label>();

    // Prevents feedback loops when we set slider values in code
    private bool _updating = false;

    private static readonly string PresetDir =
      Path.Combine(Environment.GetFolderPath(
      Environment.SpecialFolder.UserProfile), "GH_Presets");

    public ParamWindow(List<ParamDef> config)
    {
      Instance = this;
      this.Closed += (s, e) => { Instance = null; };
      _config = config;
      Title = "Parametric Controls";
      Resizable = true;
      MinimumSize = new Size(460, 80);
      BuildUI();
    }

    void BuildUI()
    {
      var doc = Instances.ActiveCanvas.Document;

      var mainLayout = new DynamicLayout
        {
          Padding = new Padding(14),
          Spacing = new Size(0, 0)
          };

      // Grid holds one row per parameter
      var grid = new TableLayout
        {
          Spacing = new Size(10, 8),
          Padding = new Padding(0, 0, 0, 14)
          };

      foreach (var p in _config)
      {
        GH_NumberSlider ghSl = FindSlider(doc, p.Name);
        if (ghSl == null) continue;

        double ghMin = (double) ghSl.Slider.Minimum;
        double ghMax = (double) ghSl.Slider.Maximum;
        double ghCurrent = (double) ghSl.Slider.Value;
        int decimals = ghSl.Slider.DecimalPlaces;
        int scale = (int) Math.Pow(10, decimals);

        var nameLbl = new Label
          {
            Text = p.Name,
            Width = 130,
            VerticalAlignment = VerticalAlignment.Center
            };

        var slider = new Slider
          {
            MinValue = (int) (ghMin * scale),
            MaxValue = (int) (ghMax * scale),
            Value = (int) (ghCurrent * scale),
            Width = 200
            };

        var readout = new Label
          {
            Text = ghCurrent.ToString("F" + decimals),
            Width = 55,
            VerticalAlignment = VerticalAlignment.Center
            };

        _sliders[p.Name] = slider;
        _readouts[p.Name] = readout;

        // Capture loop variables for the closure
        var pCopy = p;
        var readoutCopy = readout;
        var sliderCopy = slider;

        int capturedScale = scale;
        int capturedDecimals = decimals;
        string capturedName = p.Name;

        slider.ValueChanged += (s, e) =>
          {
          if (_updating) return;

          double val = sliderCopy.Value / (double) capturedScale;
          readoutCopy.Text = val.ToString("F" + capturedDecimals);

          var d = Instances.ActiveCanvas.Document;
          SetSlider(d, capturedName, val);
          d.NewSolution(false);
          };

        grid.Rows.Add(new TableRow(
          new TableCell(nameLbl, false),
          new TableCell(slider, true),
          new TableCell(readout, false)
          ));
      }

      mainLayout.AddRow(grid);

      // Button row at the bottom
      var btnLayout = new DynamicLayout { Spacing = new Size(8, 0) };
      btnLayout.BeginHorizontal();

      var saveBtn = new Button { Text = "Save Preset" };
      var loadBtn = new Button { Text = "Load Preset" };
      var syncBtn = new Button { Text = "Sync from GH" };

      saveBtn.Click += OnSave;
      loadBtn.Click += OnLoad;
      syncBtn.Click += OnSync;

      btnLayout.Add(saveBtn);
      btnLayout.Add(loadBtn);
      btnLayout.Add(syncBtn);
      btnLayout.EndHorizontal();

      mainLayout.AddRow(btnLayout);
      Content = mainLayout;
    }

    // Sync button — pulls current GH slider values INTO the panel
    void OnSync(object sender, EventArgs e)
    {
      _updating = true;
      var doc = Instances.ActiveCanvas.Document;

      foreach (var p in _config)
      {
        double? val = GetSliderValue(doc, p.Name);
        if (val == null) continue;

        GH_NumberSlider ghSl = FindSlider(doc, p.Name);
        if (ghSl == null) continue;
        int dec = ghSl.Slider.DecimalPlaces;
        int scale = (int) Math.Pow(10, dec);
        _sliders[p.Name].Value = (int) (val.Value * scale);
        _readouts[p.Name].Text = val.Value.ToString("F" + dec);
      }

      _updating = false;
    }

    void OnSave(object sender, EventArgs e)
    {
      var doc = Instances.ActiveCanvas.Document;
      var preset = new Dictionary<string, double>();

      foreach (var p in _config)
      {
        double? v = GetSliderValue(doc, p.Name);
        if (v.HasValue) preset[p.Name] = v.Value;
      }

      var dlg = new SaveFileDialog { Title = "Save Preset" };
      dlg.Filters.Add(new FileFilter("JSON Preset", ".json"));

      if (!Directory.Exists(PresetDir))
        Directory.CreateDirectory(PresetDir);

      if (dlg.ShowDialog(this) == DialogResult.Ok)
      {
        string path = dlg.FileName;
        if (!path.EndsWith(".json")) path += ".json";
        File.WriteAllText(path,
          JsonConvert.SerializeObject(preset, Formatting.Indented));
      }
    }

    void OnLoad(object sender, EventArgs e)
    {
      var dlg = new OpenFileDialog { Title = "Load Preset" };
      dlg.Filters.Add(new FileFilter("JSON Preset", ".json"));

      if (dlg.ShowDialog(this) != DialogResult.Ok) return;

      var preset = JsonConvert.DeserializeObject<Dictionary<string, double>>(
        File.ReadAllText(dlg.FileName));

      var doc = Instances.ActiveCanvas.Document;
      _updating = true;

      foreach (var kvp in preset)
      {
        SetSlider(doc, kvp.Key, kvp.Value);

        if (_sliders.ContainsKey(kvp.Key))
        {
          GH_NumberSlider ghSl = FindSlider(doc, kvp.Key);
          if (ghSl == null) continue;
          int dec = ghSl.Slider.DecimalPlaces;
          int scale = (int) Math.Pow(10, dec);
          _sliders[kvp.Key].Value = (int) (kvp.Value * scale);
          _readouts[kvp.Key].Text = kvp.Value.ToString("F" + dec);
        }
      }

      _updating = false;
      doc.NewSolution(false);
    }
  }
# ---------- end rhinoui ----------

floornum = Slider(23, range=0..100)
floorheight = Slider(7, range=0..100)
neg = Negative(Value=floorsize)
dom = ConstructDomain(DomainStart=neg, DomainEnd=floorsize)
rectangle = Rectangle(Plane=PlaneXY(0, 0, 0), XSize=dom, YSize=dom, Radius=cornerradius)  # -> Rectangle, Length
floorrotationangle = Slider(4, range=0..100)
series = Series(Start=0, Step=floorheight, Count=floornum)
Z = UnitZ(Factor=series)
move = Move(Geometry=rectangle.Rectangle, Motion=Z)  # -> Geometry, Transform
series_2 = Series(Start=0, Step=floorrotationangle, Count=floornum)
rad = Radians(Degrees=series_2)
rotate = Rotate(Geometry=move.Geometry, Angle=rad, Plane=PlaneXY(0, 0, 0))  # -> Geometry, Transform
boundary = BoundarySurfaces(Edges=rotate.Geometry)
